# Grasshopper definition scriptable-braid-export-processer_1.0_draft.gh (Grasshopper 0.9.76)
# plug-ins: Python Interpreter

panel = Panel("""{0,0,0}
{0,0,2}
{0,0,4}
{0,0,6}
{0,0,8}
{2,0,10}""")
python = PythonScript(list=panel)  # -> vect_list; inputs multiplier: Int32, list: list of Point3d
# ---------- python: Python ----------
import Rhino as rc
import Rhino.Geometry as r
import scriptcontext as sc 
import rhinoscriptsyntax as rs

radius = 0.5
vect_list = []
index = 0

while index < len(list) - 1: 
    startPoint = list[index]
    endPoint = list[index + 1]
    
    line = r.Line(startPoint, endPoint)
    curve = r.LineCurve(line)
    
      
    ### PLANES AND CIRCLES ### : 
    planeBegin = r.Plane(line.From, r.Vector3d.Subtract( r.Vector3d(line.From),r.Vector3d(line.To)))
    planeEnd = r.Plane(line.To, r.Vector3d.Subtract( r.Vector3d(line.From),r.Vector3d(line.To)))
    
    circleBegin = r.Circle(planeBegin, radius).ToNurbsCurve()
    circleEnd = r.Circle(planeEnd, radius).ToNurbsCurve() 
    curveList = [circleBegin, circleEnd]
    
    ### BREPS AND MESHES ### : 
    brepSurfaces = r.Brep.CreateFromLoft(curveList, r.Point3d.Unset, r.Point3d.Unset, r.LoftType.Straight, False)    
    
    #TODO: This has 4x too many vertices and faces
    mesh = r.Mesh.CreateFromBrep(brepSurfaces[0], r.MeshingParameters.Minimal)

    vect_list.append(mesh[0])
    index += 1
# ---------- end python ----------
panel_2 = Panel(python)
