# Grasshopper definition udp.gh (Grasshopper 0.9.76)
# plug-ins: Python Interpreter, gHowl

directorypath_with_backslashes_no_spaces = Panel("C:\Users\patri\Desktop\braid-evolution\unity\interactive-braid-evolution\Assets\Geometry\test")  # "DirectoryPath with Backslashes NO SPACES and FileName Minus Extension"
brep = Brep([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])

# ---- group: Polygon grid
number_slider = Slider(1, range=0..10)
division = Division(A=number_slider, B="2")
sqgrid = Square(Plane=PlaneXY(0, 0, 0), Size=number_slider, ExtentX=Slider(7, range=0..10), ExtentY=Slider(8, range=0..10))  # -> Cells, Points
polygon = Polygon(Plane=sqgrid.Points, Radius=division, Segments=Slider(3, range=3..8), FilletRadius=0)  # -> Polygon, Length

# ---- group: Network configuration for recieving
ip_to_receive_on_this_computer = Panel("10.13.1.197")
port_to_receive_on = Panel("8051")
udp = UDPReceiver(Address=ip_to_receive_on_this_computer, Port=port_to_receive_on, Pattern=0)  # -> Info, Data
panel = Panel(udp.Info)

# ----
the_message_coming_from_unity = Panel(udp.Data)

# ---- group: JSON decoder
json_loader = PythonScript(data=udp.Data)  # -> object
# ---------- json_loader: Python ----------
import json 

j = json.loads(data)

object = j
# ---------- end json_loader ----------

# ---- group: Model exporting
model_export = PythonScript(FileNameToSave=directorypath_with_backslashes_no_spaces, Brep=brep, jsonObject=json_loader)  # -> message; inputs Brep: list of Brep
# ---------- model_export: Python ----------
import rhinoscriptsyntax
import Rhino


if(jsonString == "Message from Unity"):
    FILE_NAME = FileNameToSave
    
    for q in range (0,len(Brep)):
      Rhino.RhinoDoc.ActiveDoc.Objects.AddBrep(Brep[q], Rhino.DocObjects.ObjectAttributes())
    
    rhinoscriptsyntax.Command("SelAll")
    rhinoscriptsyntax.Command("-Export " + FILE_NAME + ".obj y=n Enter Enter") #y=n turns off silly Y/Z axis swap! Use no spaces in the file path.
    rhinoscriptsyntax.Command("Delete Enter")
    
    message = True
else :
    message = False
# ---------- end model_export ----------

# ----
yz = YZPlane(Origin=Point(0, 0, 0))

# ---- group: Polygon grid
number_slider_2 = Slider(1, range=0..10)
division_2 = Division(A=number_slider_2, B="2")
sqgrid_2 = Square(Plane=yz, Size=number_slider_2, ExtentX=Slider(7, range=0..10), ExtentY=Slider(8, range=0..10))  # -> Cells, Points
polygon_2 = Polygon(Plane=sqgrid_2.Points, Radius=division_2, Segments=Slider(3, range=3..8), FilletRadius=0)  # -> Polygon, Length

# ---- group: JSON encoder
json_encoder = PythonScript(exportSucess=model_export, jsonObject=json_loader)  # -> shouldExport, jsonString; inputs exportSucess: Boolean
# ---------- json_encoder: Python ----------
import json 



jsonString = json.dumps({
    'name': 'new_model', 
    'generation':'2', 
    'sucess': exportSucess
})
# ---------- end json_encoder ----------

# ---- group: Network configuration for sending
ip_to_send_to = Panel("10.13.1.197")
port_to_send_to = Panel("8050")
udp_2 = UDPSender(Address=ip_to_send_to, Port=port_to_send_to, Pattern=0, Data=json_encoder.jsonString)
panel_2 = Panel(udp_2)

# ---- group: Basic modelling
number_slider_3 = Slider(0, range=0..10)
panel_3 = Panel("2")
pt = Point(<point referenced from the Rhino model>)
number_slider_4 = Slider(7.5, range=0..10)

pt_2 = ConstructPoint(XCoordinate=number_slider_4, YCoordinate=number_slider_4, ZCoordinate=number_slider_4)
division_3 = Division(A=number_slider_4, B=panel_3)
pt_3 = ConstructPoint(XCoordinate=number_slider_3, YCoordinate=number_slider_3, ZCoordinate=number_slider_3)
pdecon = Deconstruct(Point=pt)  # -> XComponent, YComponent, ZComponent
addition = Addition(A=division_3, B=pdecon.XComponent)
addition_2 = Addition(A=division_3, B=pdecon.YComponent)
addition_3 = Addition(A=division_3, B=pdecon.ZComponent)
pt_4 = ConstructPoint(XCoordinate=addition, YCoordinate=addition_2, ZCoordinate=addition_3)
box = Box2Pt(PointA=pt, PointB=pt_4, Plane=PlaneXY(0, 0, 0))
box_2 = Box2Pt(PointA=pt_3, PointB=pt_2, Plane=PlaneXY(0, 0, 0))

mcol = MeshColours(Mesh=box_2, Colours=ColourSwatch(SwatchColor=RGB(255, 255, 255)))

# ---- group: 16: Divide Domain Squared for UV Subdivision
number_slider_5 = Slider(6, range=0..10)
number_slider_6 = Slider(3, range=0..10)
number_slider_7 = Slider(7, range=0..10)
number_slider_8 = Slider(6, range=0..10)
crv = Curve(<curve referenced from the Rhino model>)
crv_2 = Curve(<curve referenced from the Rhino model>)
srf = Surface(crv)
srf_2 = Surface(<surface referenced from the Rhino model>)
srf_3 = Surface(crv_2)

# ---- group: 16: Divide Domain Squared for UV Subdivision / Math > Dom
divide = DivideDomain²(Domain=srf_2, UCount=number_slider_6, VCount=number_slider_5)

divide_2 = DivideDomain²(Domain=srf, UCount=number_slider_8, VCount=number_slider_7)

# ---- group: 16: Divide Domain Squared for UV Subdivision (continued)
subsrf = Isotrim(Surface=srf_2, Domain=divide)
subsrf_2 = Isotrim(Surface=srf, Domain=divide_2)

# ---- group: Rectangle Gradient Grid
number_slider_9 = Slider(8, range=0..10)
number_slider_10 = Slider(1, range=0..10)
number_slider_11 = Slider(8, range=0..10)
number_slider_12 = Slider(6, range=0..10)
number_slider_13 = Slider(5, range=0..10)
number_slider_14 = Slider(3, range=0..10)
neg = Negative(Value=number_slider_10)
neg_2 = Negative(Value=number_slider_14)
number_slider_15 = Slider(0.05, range=0..1.5)
number_slider_16 = Slider(1.5, range=0..1.5)

# ---- group: Rectangle Gradient Grid / Vect > Grid
recgrid = Rectangular(
    Plane=PlaneXY(0, 0, 0),
    SizeX=number_slider_11,
    SizeY=number_slider_12,
    ExtentX=number_slider_13,
    ExtentY=number_slider_9)  # -> Cells, flatten(Points)

# ---- group: Rectangle Gradient Grid / Math > Dom
dom = ConstructDomain(DomainStart=neg_2, DomainEnd=number_slider_14)

dom_2 = ConstructDomain(DomainStart=neg, DomainEnd=number_slider_10)

# ---- group: Rectangle Gradient Grid (continued)
lng = ListLength(List=flatten(recgrid.Points))
rectangle = Rectangle(Plane=recgrid.Points, XSize=dom, YSize=dom_2, Radius=0)  # -> Rectangle, Length

# ----
dom_3 = ConstructDomain(DomainStart=number_slider_15, DomainEnd=number_slider_16)

# ---- group: Rectangle Gradient Grid / Set > Seq
range = Range(Domain=dom_3, Steps=lng)

# ---- group: Rectangle Gradient Grid / Trans > Affine
scale = Scale(Geometry=rectangle.Rectangle, Center=recgrid.Points, Factor=range)  # -> Geometry, Transform

# ---- group: Element Isolation Part 1
srf_4 = Surface(scale.Geometry)
number_slider_17 = Slider(0.15, range=0..0.55)
number_slider_18 = Slider(2, range=0..3)
panel_4 = Panel("2")
Z = UnitZ(Factor=Slider(3, range=0..10))

# ---- group: Element Isolation Part 1 / Srf > analysis
debrep = DeconstructBrep(Brep=srf_4)  # -> Faces, Edges, Vertices

# ---- group: Element Isolation Part 1 / Srf > Freeform
pipe = Pipe(Curve=debrep.Edges, Radius=number_slider_17, Caps=panel_4)

# ---- group: Element Isolation Part 1 / Set > List
item = ListItem(List=debrep.Edges, Index=number_slider_18, Wrap=True)

# ---- group: Element Isolation Part 1 / Srf > Frfm
extr = Extrude(Base=item, Direction=Z)
